# Grasshopper definition geostreamer2.gh (Grasshopper 1.0.7)
# plug-ins: GeoGrasshopper

brep = Brep(<brep referenced from the Rhino model>)
crv = Curve([<curve referenced from the Rhino model> x2])
mesh = MeshBrep(
    Brep=brep,
    Settings={GridMaxCount=0, GridMinCount=16, JaggedSeams=False, MaxEdgeLength=0, MinEdgeLength=0.0001, MinTolerance=0, Refine=True, RefineAngle=0, RelativeTolerance=0.65, SimplePlanes=True, Tolerance=0})
geostream = GeometryStreamer(IpAdress="192.168.1.221", Connect=Toggle(True), UpdateDebug=Button(), Meshes=mesh)  # -> IpAdress, Debug
panel = Panel(geostream.Debug)
